# Grasshopper definition hops_test.gh (Grasshopper 1.0.7)
# plug-ins: Hops, Heteroptera

panel = Panel("/Volumes/GoogleDrive/My Drive/2021/coursework_fall_2021/4450_COMPUTATIONAL_DESIGN/final_project/geometric_sound/src/hops_test.py")
number_slider = Slider(1, range=0..1)
geometry_pipeline = GeometryPipeline(
    GroupByLayer=False,
    GroupByType=False,
    IncludeHidden=True,
    IncludeLocked=True,
    LayerFilter="single_line",
    NameFilter="*",
    SublayerFiltering=True,
    TypeFilter=4)
geometry_pipeline_2 = GeometryPipeline(
    GroupByLayer=False,
    GroupByType=False,
    IncludeHidden=True,
    IncludeLocked=True,
    LayerFilter="G",
    NameFilter="*",
    SublayerFiltering=True,
    TypeFilter=4)
network_from_lines = NetworkFromLines(Lines=geometry_pipeline)  # -> PointPointTopology, simplify(ConnectionPointTopology), simplify(flatten(Points)), flatten(Lines)

edges = Data(flatten(network_from_lines.ConnectionPointTopology))
points = Data(network_from_lines.Points)
lines = Data(network_from_lines.Lines)

network_from_lines_2 = NetworkFromLines(Lines=geometry_pipeline_2)  # -> PointPointTopology, simplify(ConnectionPointTopology), simplify(flatten(Points)), flatten(Lines)

points_2 = Data(network_from_lines_2.Points)
lines_2 = Data(network_from_lines_2.Lines)
edges_2 = Data(network_from_lines_2.ConnectionPointTopology)

stream_filter = StreamFilter(Gate=number_slider, Stream0=lines, Stream1=lines_2)
stream_filter_2 = StreamFilter(Gate=number_slider, Stream0=points, Stream1=points_2)
stream_filter_3 = StreamFilter(Gate=number_slider, Stream0=edges, Stream1=edges_2)

points_3 = Data(stream_filter_2)
edges_3 = Data(stream_filter_3)
lines_3 = Data(stream_filter)
load_graph = Trigger(Interval=-1000, TimerInterval=1000, Target=hops_4)  # disabled
speed = Slider(1, range=0..4)

# ----
# add explorer
select_edge = Slider(1, range=0..1)
edges_4 = Data(edges_3)
curves = Data(lines_3)
cluster = Cluster(list_2=curves, tree=edges_4, list=curves, B=select_edge)
hops = Hops(
    Add=Button(),
    Edges=cluster,
    Speed=speed,
    CacheResultsInMemory=False,
    CacheSolveResults=False,
    RemoteDefinitionLocation="http://127.0.0.1:5000/delphi_add_mite",
    RemoteSolveVersion=(0, 1, 0),
    ShowInput_Enabled=False,
    ShowInput_Path=False,
    SynchronousSolve=True)

trigger = Trigger(Interval=20, TimerInterval=20, Target=hops_2)
hops_2 = Hops(
    CacheResultsInMemory=False,
    CacheSolveResults=False,
    RemoteDefinitionLocation="http://127.0.0.1:5000/delphi_state",
    RemoteSolveVersion=(0, 1, 0),
    ShowInput_Enabled=False,
    ShowInput_Path=False,
    SynchronousSolve=True)
point = Point(hops_2)
panel_3 = Panel(point)
sphere = Sphere(Base=point, Radius=0.2)

speed_2 = Slider(0.841, range=0..4)
pause = Button()
start = Button()
rest = Button()
hops_3 = Hops(
    Start=start,
    Pause=pause,
    Reset=rest,
    Speed=speed_2,
    CacheResultsInMemory=False,
    CacheSolveResults=False,
    RemoteDefinitionLocation="http://127.0.0.1:5000/run_delphi",
    RemoteSolveVersion=(0, 1, 0),
    ShowInput_Enabled=False,
    ShowInput_Path=False,
    SynchronousSolve=True)
panel_4 = Panel(cluster)
boolean = Boolean(True)
graft_tree = GraftTree(IncludeEmptyLists=True, IncludeNullItems=True)  # -> simplify(Tree)
panel_5 = Panel(network_from_lines_2.ConnectionPointTopology)
graft_tree_2 = GraftTree(Tree=graft_tree, IncludeEmptyLists=True, IncludeNullItems=True)
panel_6 = Panel(graft_tree_2)
match_text = MatchText(Text=panel_5, Pattern=graft_tree_2, Case=True)
list_item = ListItem(List=match_text, Index=0, Wrap=True)  # -> Item, Item1
gate_or = GateOr(A=list_item.Item, B=list_item.Item1)  # -> flatten(Result)
panel_7 = Panel(match_text)
cull_pattern = CullPattern(List=flatten(network_from_lines_2.Lines), CullPattern=flatten(gate_or))
panel_8 = Panel(cull_pattern)

edges_5 = Data(simplify(edges_3))
points_4 = Data(points_3)
curves_2 = Data(lines_3)

# ----
# edge_data
data = Data(curves_2)
speed_3 = Slider(3.644, range=0..10)
length = Length(Curve=data)
division = Division(A=speed_3, B=length)

# ----
# nodes
point_2 = Point(points_4)
list_length = ListLength(List=point_2)
subtraction = Subtraction(A=list_length, B=1)
range = Range(Domain=subtraction, Steps=subtraction)  # -> flatten(Range)

# ----
# node_data
deconstruct = Deconstruct(Point=points_4)  # -> XComponent, YComponent, ZComponent
entwine = Entwine(Branch00=deconstruct.XComponent, Branch01=deconstruct.YComponent, FlattenInputs=True)

expression = Expression(x=deconstruct.XComponent, y=deconstruct.YComponent, Expression="Sqrt(x² + y²)")

data_2 = Data(expression)

# ----
# tuner
data_3 = Data(data_2)
average = Average(Input=data_3)
expression_2 = Expression(x=data_3, A4=average, scale=Slider(2, range=0..10), Expression="69 + (x - A4) * scale")
tuned_data = Integer(expression_2)

hops_4 = Hops(
    Nodes=range,
    Edges=edges_5,
    EdgeCurves=curves_2,
    Speed=division,
    Note=tuned_data,
    NoteVelocity=Slider(0.831, range=0..1),
    Duration=Slider(0.3, range=0..2),
    CacheResultsInMemory=False,
    CacheSolveResults=False,
    RemoteDefinitionLocation="http://127.0.0.1:5000/delphi_setup",
    RemoteSolveVersion=(0, 1, 0),
    ShowInput_Enabled=False,
    ShowInput_Path=False,
    SynchronousSolve=True)

# ==== cluster Cluster
list = ClusterInput()
list_length = ListLength(List=list)
B = ClusterInput()
subtraction = Subtraction(A=list_length, B=1)
multiplication = Multiplication(A=subtraction, B=B)
list_2 = ClusterInput()
tree = ClusterInput()
integer = Integer(multiplication)
list_item = ListItem(List=list_2, Index=integer, Wrap=True)
tree_branch = TreeBranch(Tree=tree, Path=integer, MaintainPaths=True)  # -> flatten(Branch)
pipe = Pipe(Curve=list_item, Radius=0.1, Caps=0)
branch = ClusterOutput(tree_branch)
colour_picker = ColourPicker(PickedColour=RGB(82, 105, 235))
custom_preview = CustomPreview(Geometry=pipe, Material=colour_picker)
